# Grasshopper definition inflation.gh (Grasshopper 1.0.7)
# plug-ins: Bifocals, Kangaroo2 Components, MeshEdit Components

# ---- group: RH_OUT:mesh
mesh = Mesh(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)

# ----
mesh_edges = MeshEdges(Mesh=mesh)  # -> NakedEdges, InteriorEdges, NonManifoldEdges
end_points = EndPoints(Curve=mesh_edges.NakedEdges)  # -> Start, End
rod = Rod(
    Polyline=mesh_edges.NakedEdges,
    LengthFactor=1,
    AngleFactor=Slider(1, range=0..1),
    AxialStrength=10,
    BendStrength=Slider(311, range=0..1000))

# ---- group: RH_IN:button
reset = Button()

# ----
livesoap = LiveSoap(
    Mesh=mesh,
    UseVolume=Toggle(True),
    VolumeChange=Slider(-1000, range=-1000..1000),
    Strength=Slider(10, range=0..10),
    Reset=reset)
plasticanchor = PlasticAnchor(
    Point=[end_points.Start, end_points.End],
    Limit=Slider(4.527, range=0..20),
    Strength=Slider(1000, range=0..1000),
    Reset=reset)

# ---- group: RH_IN:iterations
number_slider = Slider(0, range=0..100)

# ----
merge = Merge(Data1=rod, Data2=plasticanchor, Data3=livesoap)  # -> flatten(Result)
zombiesolver = ZombieSolver(GoalObjects=merge, Threshold=1e-10, Tolerance=0.01, MaxIterations=number_slider)  # -> I, V, O
clean_tree = CleanTree(RemoveNulls=True, RemoveInvalid=True, RemoveEmpty=False, Tree=zombiesolver.O)
list_item = ListItem(List=clean_tree, Index=0, Wrap=True)
mesh_volume = MeshVolume(Mesh=list_item)  # -> Volume, Centroid
construct_plane = ConstructPlane(Origin=mesh_volume.Centroid, XAxis=Vector(1, 0, 0), YAxis=Vector(0, 1, 0))
scale = Scale(Geometry=list_item, Center=mesh_volume.Centroid, Factor=Slider(1.453, range=0..10))  # -> Geometry, Transform
x = Slider(1.068, range=0..2)
y = Slider(1.19, range=0..2)
scale_nu = ScaleNU(Geometry=scale.Geometry, Plane=construct_plane, ScaleX=x, ScaleY=y, ScaleZ=1)  # -> Geometry, Transform
xy_plane = XYPlane(Origin=Point(0, 0, 0))
mesh_edges_2 = MeshEdges(Mesh=scale_nu.Geometry)  # -> NakedEdges, InteriorEdges, NonManifoldEdges

# ---- group: RH_OUT:shell
curve = Curve(mesh_edges_2.InteriorEdges)
